# Grasshopper definition orient3Pt.gh (Grasshopper 1.0.7)

geometry = GetGeometry(AtLeast=1, AtMost=1, DeleteInput=False, Filter=1074004029, TreeAccess=False)
refpoint1 = GetPoint(AtLeast=1, AtMost=1, Realtime=True, TreeAccess=False)
refpoint2 = GetPoint(AtLeast=1, AtMost=1, Realtime=True, TreeAccess=False)
refpoint3 = GetPoint(AtLeast=1, AtMost=1, Realtime=True, TreeAccess=False)
targetpoint1 = GetPoint(AtLeast=1, AtMost=1, Realtime=True, TreeAccess=False)
targetpoint2 = GetPoint(AtLeast=1, AtMost=1, Realtime=True, TreeAccess=False)
targetpoint3 = GetPoint(AtLeast=1, AtMost=1, Realtime=True, TreeAccess=False)
scale = GetBoolean(AtLeast=1, AtMost=1, FalseValue="False", Prompt="Do You want scale your objects?", TreeAccess=False, TrueValue="True")

geometry_2 = Geometry(geometry)
refpoint1_2 = Point(refpoint1)
refpoint2_2 = Point(refpoint2)
refpoint3_2 = Point(refpoint3)
targetpoint1_2 = Point(targetpoint1)
targetpoint2_2 = Point(targetpoint2)
targetpoint3_2 = Point(targetpoint3)
boolean = Boolean(scale)
vector_2pt = Vector2Pt(PointA=refpoint1_2, PointB=refpoint2_2, Unitize=True)  # -> Vector, Length
vector_2pt_2 = Vector2Pt(PointA=refpoint1_2, PointB=refpoint3_2, Unitize=True)  # -> Vector, Length
vector_2pt_3 = Vector2Pt(PointA=targetpoint1_2, PointB=targetpoint2_2, Unitize=True)  # -> Vector, Length
vector_2pt_4 = Vector2Pt(PointA=targetpoint1_2, PointB=targetpoint3_2, Unitize=True)  # -> Vector, Length
construct_plane = ConstructPlane(Origin=refpoint1_2, XAxis=vector_2pt.Vector, YAxis=vector_2pt_2.Vector)
construct_plane_2 = ConstructPlane(Origin=targetpoint1_2, XAxis=vector_2pt_3.Vector, YAxis=vector_2pt_4.Vector)
distance = Distance(PointA=refpoint1_2, PointB=refpoint2_2)
distance_2 = Distance(PointA=targetpoint1_2, PointB=targetpoint2_2)
orient = Orient(Geometry=geometry_2, Source=construct_plane, Target=construct_plane_2)  # -> Geometry, Transform
division = Division(A=distance_2, B=distance)
scale_2 = Scale(Geometry=orient.Geometry, Center=targetpoint1_2, Factor=division)  # -> Geometry, Transform
stream_filter = StreamFilter(Gate=boolean, Stream0=orient.Geometry, Stream1=scale_2.Geometry)
context_bake = ContextBake(OrientedGeometry=stream_filter)
